# Grasshopper definition Printed_Paper_Actuator_reference.gh (Grasshopper 1.0.6)

number_slider = Slider(180, range=0..180)

# ---- group: Width
gene5 = GenePool(Decimals=2, Maximum=2, Minimum=0, Value=[1, 1, 1])

# ---- group: Speed
gene4 = GenePool(Decimals=0, Maximum=2500, Minimum=500, Value=[1500, 1500, 1500])

# ---- group: Layer
gene3 = GenePool(Decimals=0, Maximum=5, Minimum=0, Value=[1, 1, 1])

# ---- group: Raster Line Pitch
gene1 = GenePool(Decimals=1, Maximum=10, Minimum=0, Value=[1.5, 1.5, 1.5])

# ---- group: Rotation
gene2 = GenePool(Decimals=0, Maximum=180, Minimum=-180, Value=[0, 0, 0])

# ---- group: Angle(actuation)
gene7 = GenePool(Decimals=0, Maximum=360, Minimum=0, Value=[0, 35, 115])

# ----
layer_height = Slider(0.2, range=0..10)
angle = Number(gene7)
srf = Surface(simplify([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]))

# ---- group: change slider pool count (ignore this part)
lng = ListLength(List=srf)
vb = VBScript(genelist="Gene1", count=lng)  # -> out, A
# ---------- vb: VB ----------
    For Each obj As IGH_DocumentObject In owner.OnPingDocument().Objects
      If (obj.ComponentGuid <> New Guid("{21553c44-ea62-475e-a8bb-62b2a3ee5ca5}")) Then Continue For
      If (obj.NickName Like genelist) Then
        CallByName(obj, "Count", CallType.Set, count)
        'CallByName(obj, "ExpireSolution", CallType.Method, False)
        Return
      End If
    Next

    Print("No matching Gene list object found")
# ---------- end vb ----------
vb_2 = VBScript(genelist="Gene2", count=lng)  # -> out, A; same code as vb
vb_3 = VBScript(genelist="Gene3", count=lng)  # -> out, A; same code as vb
vb_4 = VBScript(genelist="Gene4", count=lng)  # -> out, A; same code as vb
vb_5 = VBScript(genelist="Gene5", count=lng)  # -> out, A; same code as vb
vb_6 = VBScript(genelist="Gene6", count=lng)  # -> out, A; same code as vb
vb_7 = VBScript(genelist="Gene7", count=lng)  # -> out, A; same code as vb

# ---- group: Border Offset
border_offset = Number(1)
crv = Curve(srf)
neg = Negative(Value=border_offset)
offset = Offset(Curve=crv, Distance=border_offset, Plane=PlaneXY(0, 0, 0), Corners=1)
offset_2 = Offset(Curve=crv, Distance=neg, Plane=PlaneXY(0, 0, 0), Corners=1)
merge = Merge(Data1=offset, Data2=offset_2)
len = Length(Curve=merge)
sort = SortList(Keys=len, ValuesA=merge)  # -> Keys, ValuesA
item = ListItem(List=sort.ValuesA, Index=0, Wrap=True)

# ----
angle_2 = Number(graft(angle))
series = Series(Start=0, Step=1, Count=lng)
int = Integer(series)
srf_2 = Surface(graft(srf))
g_code_gen = BooleanToggle(True)

# ---- group: G-code generation
speed = Number(gene4)
fastmovespeed = Number(9000)
ins = InsertItems(List=graft(speed), Item=fastmovespeed, Indices=0, Wrap=True)
int_2 = Integer(ins)

# ---- group: Slicer
interval = Number(gene1)
srf_3 = Surface(srf)
area = Area(Geometry=srf_3)  # -> Area, Centroid
srf_cp = SurfaceClosestPoint(Point=area.Centroid, Surface=srf_3)  # -> Point, UVPoint, Distance
evalsrf = EvaluateSurface(Surface=srf_3, Point=srf_cp.UVPoint)  # -> Point, Normal, Frame
rotate = Rotate(Geometry=evalsrf.Frame, Angle=degrees(gene2), Plane=evalsrf.Frame)  # -> Geometry, Transform
bbox = BoundingBox(Content=graft(srf_3), Plane=graft(rotate.Geometry), UnionBox=False)  # -> flatten(Box), Box_2
deplane = DeconstructPlane(Plane=rotate.Geometry)  # -> Origin, XAxis, YAxis, ZAxis
debox = DeconstructBox(Box=bbox.Box)  # -> Plane, X, Y, Z
dedomain = DeconstructDomain(Domain=debox.X)  # -> Start, End
dedomain_2 = DeconstructDomain(Domain=debox.Y)  # -> Start, End
pt = PointOriented(BasePlane=rotate.Geometry, UComponent=dedomain.Start, VComponent=dedomain_2.Start, WComponent=0)
contour = Contour(Shape=srf_3, Point=pt, Direction=deplane.XAxis, Distance=interval)
trim = TrimTree(Tree=contour, Depth=1)
trim_2 = TrimWithRegion(Curve=trim, Region=item, Plane=graft(rotate.Geometry))  # -> Inside, Outside
box = Box(graft(bbox.Box))

# ----
box_2 = Box(box)
debox_2 = DeconstructBox(Box=box_2)  # -> Plane, X, Y, Z

pi = Pi(Factor=2)
num = Number(debox_2.Y)
multiplication = Multiplication(A=num, B=360)
multiplication_2 = Multiplication(A=angle_2, B=pi)
division = Division(A=multiplication, B=multiplication_2)

tag = TextTag3D(Location=evalsrf.Frame, Text=int, Size=5, Justification=5)

resolution = Slider(25, range=2..50)
range = Range(Domain=debox_2.Y, Steps=resolution)
series_2 = Series(Start=0, Step=1, Count=resolution)
item_2 = ListItem(List=range, Index=series_2, Wrap=True)  # -> Item, Item1
dom = ConstructDomain(DomainStart=item_2.Item, DomainEnd=item_2.Item1)

trim_3 = TrimTree(Tree=trim_2.Inside, Depth=1)

# ---- group: Slicer (continued)
crv_2 = Curve(trim_3)

# ---- group: PathGen
crv_3 = Curve(crv_2)
lng_2 = ListLength(List=crv_3)
repeat = RepeatData(Data=[0, 1], Length=lng_2)
sift = SiftPattern(List=crv_3, SiftPattern=repeat)  # -> Output0, Output1
flip = FlipCurve(Curve=sift.Output1)  # -> Curve, Flag
p_n_c = PickNChoose(Pattern=repeat, Stream0=sift.Output0, Stream1=flip.Curve)
trim_4 = TrimTree(Tree=p_n_c, Depth=1)
cp = ControlPoints(Curve=trim_4)  # -> Points, Weights, Knots
trim_5 = TrimTree(Tree=cp.Points, Depth=1)
pline = PolyLine(Vertices=trim_5, Closed=False)
controlpoints = Point(simplify(trim_5))
printpath = Curve(pline)

# ---- group: generate reorient 3D target plane
dedomain_3 = DeconstructDomain(Domain=debox_2.X)  # -> Start, End
pt_2 = PointOriented(BasePlane=debox_2.Plane, UComponent=dedomain_3.Start, VComponent=range, WComponent=0)
pt_3 = PointOriented(BasePlane=debox_2.Plane, UComponent=dedomain_3.End, VComponent=range, WComponent=0)
ln = Line(StartPoint=pt_2, EndPoint=pt_3)
eval = EvaluateCurve(Curve=reparameterize(ln), Parameter=0.5)  # -> Point, Tangent, Angle
deplane_2 = DeconstructPlane(Plane=debox_2.Plane)  # -> Origin, XAxis, YAxis, ZAxis
pl = ConstructPlane(Origin=eval.Point, XAxis=deplane_2.XAxis, YAxis=deplane_2.YAxis)
item_3 = ListItem(List=pl, Index=0, Wrap=True)
pt_4 = PointOriented(BasePlane=item_3, UComponent=0, VComponent=0, WComponent=division)
pl_2 = ConstructPlane(Origin=pt_4, XAxis=deplane_2.XAxis, YAxis=deplane_2.YAxis)
pt_5 = PointOriented(BasePlane=pl_2, UComponent=-1, VComponent=0, WComponent=0)
pt_6 = PointOriented(BasePlane=pl_2, UComponent=1, VComponent=0, WComponent=0)
range_2 = Range(Domain=angle_2, Steps=resolution)
ln_2 = Line(StartPoint=pt_5, EndPoint=pt_6)
rotax = RotateAxis(Geometry=item_3, Angle=degrees(range_2), Axis=ln_2)  # -> Geometry, Transform

# ---- group: slice shape into stripes
rectangle = Rectangle(Plane=debox_2.Plane, XSize=debox_2.X, YSize=dom, Radius=0)  # -> Rectangle, Length
srfsplit = SurfaceSplit(Surface=srf_2, Curves=rectangle.Rectangle)
cpoly = ControlPolygon(Curve=srfsplit)  # -> Polygon, Points
dedomain_4 = DeconstructDomain(Domain=debox_2.Y)  # -> Start, End
pt_7 = PointOriented(BasePlane=debox_2.Plane, UComponent=0, VComponent=dedomain_4.Start, WComponent=0)
pt_8 = PointOriented(BasePlane=debox_2.Plane, UComponent=0, VComponent=dedomain_4.End, WComponent=0)
pcen = PolygonCenter(Polyline=cpoly.Polygon)  # -> CenterV, CenterE, CenterA
ln_3 = Line(StartPoint=pt_7, EndPoint=pt_8)
crv_cp = CurveClosestPoint(Point=pcen.CenterE, Curve=reparameterize(ln_3))  # -> Point, Parameter, Distance
sort_2 = SortList(Keys=crv_cp.Parameter, ValuesA=srfsplit)  # -> Keys, ValuesA

# ----
dispatch = Dispatch(List=controlpoints, DispatchPattern=g_code_gen)  # -> ListA, ListB
series_3 = Series(Start=0, Step=1, Count=resolution)

# ---- group: averaging planes
item_4 = ListItem(List=pl, Index=series_3, Wrap=True)  # -> Item, Item1
deplane_3 = DeconstructPlane(Plane=item_4.Item)  # -> Origin, XAxis, YAxis, ZAxis
deplane_4 = DeconstructPlane(Plane=item_4.Item1)  # -> Origin, XAxis, YAxis, ZAxis
addition = Addition(A=deplane_3.Origin, B=deplane_4.Origin)
division_2 = Division(A=addition, B=2)
addition_2 = Addition(A=deplane_3.XAxis, B=deplane_4.XAxis)
addition_3 = Addition(A=deplane_3.YAxis, B=deplane_4.YAxis)
pl_3 = ConstructPlane(Origin=division_2, XAxis=addition_2, YAxis=addition_3)

item_5 = ListItem(List=rotax.Geometry, Index=series_3, Wrap=True)  # -> Item, Item1
deplane_5 = DeconstructPlane(Plane=item_5.Item)  # -> Origin, XAxis, YAxis, ZAxis
deplane_6 = DeconstructPlane(Plane=item_5.Item1)  # -> Origin, XAxis, YAxis, ZAxis
addition_4 = Addition(A=deplane_5.Origin, B=deplane_6.Origin)
division_3 = Division(A=addition_4, B=2)
addition_5 = Addition(A=deplane_5.XAxis, B=deplane_6.XAxis)
addition_6 = Addition(A=deplane_5.YAxis, B=deplane_6.YAxis)
pl_4 = ConstructPlane(Origin=division_3, XAxis=addition_5, YAxis=addition_6)

# ---- group: switch from plannar to coiled
equals = Equality(FirstNumber=angle_2, SecondNumber=0)  # -> Equality, Inequality
repeat_2 = RepeatData(Data=equals.Equality, Length=resolution)
p_n_c_2 = PickNChoose(Pattern=repeat_2, Stream0=pl_4, Stream1=pl_3)

# ---- group: reorient
div = DivideDomain(Domain=Domain(0, 1), Count=resolution)
fdom = FindDomain(Domains=div, Number=crv_cp.Parameter, Strict=False)  # -> Index, Neighbour
item_6 = ListItem(List=pl_3, Index=fdom.Index, Wrap=True)
item_7 = ListItem(List=p_n_c_2, Index=fdom.Index, Wrap=True)
orient = Orient(Geometry=srfsplit, Source=item_6, Target=item_7)  # -> Geometry, Transform
mesh = MeshBrep(
    Brep=orient.Geometry,
    Settings={GridMaxCount=0, GridMinCount=16, JaggedSeams=False, MaxEdgeLength=0, MinEdgeLength=0.0001, MinTolerance=0, Refine=True, RefineAngle=0, RelativeTolerance=0.65, SimplePlanes=True, Tolerance=0})

# ---- group: G-code generation
layers = Integer(gene3)
controlpoints_2 = Point(dispatch.ListA)
layerheight = Number(layer_height)
width_extruder_feed_rate_modifier = Number(gene5)
feedrateconstant_extruder_mm_movement_mm = Number(0.039911)
int_3 = Integer(2)
multiplication_3 = Multiplication(A=width_extruder_feed_rate_modifier, B=feedrateconstant_extruder_mm_movement_mm)
fastmovespeed_2 = Number(0)
code_injection_head = Panel("""G90
M83
; **** Replicator 2X start.gcode ****
M73 P0 ; Enable build progress
G162 X Y F3000 ; Home XY maximum
G161 Z F1200 ; Home Z minimum
G92 Z-5 ; Set Z to -5
G1 Z0 ; Move Z to 0
G161 Z F100 ; Home Z slowly
M132 X Y Z A B ; Recall home offsets
M135 T0 ; Load right extruder offsets
G1 X-130 Y-75 Z30 F9000 ; Move to wait position off table
G130 X20 Y20 Z20 A20 B20 ; Lower stepper Vrefs while heating
M127 ; Set fan speed
M140 S0 T0 ; Heat buildplate
M104 S235 T1 ; Heat left extruder
M133 T1 ; Stabilize left extruder temperature
G130 X127 Y127 Z40 A127 B127 ; Default stepper Vrefs
G92 A0 B0 ; Zero extruders
M135 T1 ; Load left extruder offsets
G1 X-100 Y-65 F9000 ; Move to front left corner of bed
G1 Z0.3 F6000 ; Move down to purge
G1 X90 Y-65 E24 F2000 ; Extrude a line of filament across the front edge of the bed
G1 X100 Y-65 F180 ; Wait for ooze
G1 X110 Y-65 F5000 ; Fast wipe
G1 Z1 F100 ; Lift
G92 A0 B0 ; zero extruders
M73 P1 ;@body (notify GPX body has started)
; **** end of start.gcode ****""")
code_injection_foot = Panel("""G1 E-1.0000 F1200
; **** Replicator 2X end.gcode ****
M73 P100 ; end build progress
G1 Z155 F1000 ; send Z axis to bottom of machine
M140 S0 T0 ; cool down HBP
M104 S0 T0 ; cool down right extruder
M104 S0 T1 ; cool down left extruder
M127 ; stop blower fan
G162 X Y F3000 ; home XY maximum
M18 ; disable stepper
M72 P1 ; play Ta-Da song
; **** end of end.gcode ****""")

pdecon = Deconstruct(Point=controlpoints_2)  # -> XComponent, YComponent, ZComponent
c_script = CSharpScript(x=pdecon.XComponent, y=pdecon.YComponent)  # -> out, A, B; inputs x: Double, y: Double
# ---------- c_script: C# ----------
    var X_Coor = x.ToString();
    var Y_Coor = y.ToString();
    int X_Fraction_Length = X_Coor.Length - X_Coor.IndexOf('.');
    int Y_Fraction_Length = Y_Coor.Length - Y_Coor.IndexOf('.');
    if(X_Fraction_Length > 4){
      string Xcoor_New = X_Coor.Substring(0, (X_Coor.IndexOf('.') + 4));
      X_Coor = Xcoor_New;
    }
    if(Y_Fraction_Length >= 4){
      string Ycoor_New = Y_Coor.Substring(0, (Y_Coor.IndexOf('.') + 4));
      Y_Coor = Ycoor_New;
    }
    A = X_Coor;
    B = Y_Coor;
# ---------- end c_script ----------
split = SplitList(List=c_script.A, Index=int_3)  # -> ListA, ListB
split_2 = SplitList(List=c_script.B, Index=int_3)  # -> ListA, ListB

lng_3 = ListLength(List=layers)
series_4 = Series(Start=0, Step=1, Count=lng_3)
repeat_3 = RepeatData(Data=graft(series_4), Length=graft(layers))
int_4 = Integer(simplify(repeat_3))
flip_2 = FlipMatrix(Data=int_4)
clean = CleanTree(RemoveNulls=True, RemoveInvalid=True, RemoveEmpty=False, Tree=flip_2)

bnd = Bounds(Numbers=layers)
dedomain_5 = DeconstructDomain(Domain=bnd)  # -> Start, End
series_5 = Series(Start=layerheight, Step=layerheight, Count=dedomain_5.End)
format = Format(Format="G1 Z{0} F100", Culture=127, Data0=series_5)  # -> simplify(graft(Text))
path_mapper = PathMapper(format, source="{A}", target="{A;-1}")
panel = Panel("{Layer,Item}")

tstat = TreeStatistics(Tree=graft(clean))  # -> Paths, Length, Count
dpath = DeconstructPath(Branch=tstat.Paths)
item_8 = ListItem(List=dpath, Index=0, Wrap=True)  # -> simplify(Item)
match = MatchTree(Tree=graft(clean), Guide=item_8)
merge_2 = Merge(Data1=item_8, Data2=match)
path = ConstructPath(Indices=merge_2)  # -> flatten(Branch)

# ---- group: G-code generation / Extrusion(@Length)
lng_4 = ListLength(List=controlpoints_2)
subtraction = Subtraction(A=lng_4, B=1)
series_6 = Series(Start=1, Step=1, Count=subtraction)
item_9 = ListItem(List=controlpoints_2, Index=series_6, Wrap=True)  # -> Item1, Item
dist = Distance(PointA=item_9.Item1, PointB=item_9.Item)

# ---- group: G-code generation (continued)
multiplication_4 = Multiplication(A=dist, B=multiplication_3)

# ---- group: G-code generation / Extrusion(@Length) (continued)
c_script_2 = CSharpScript(x=multiplication_4)  # -> out, A; inputs x: Double
# ---------- c_script_2: C# ----------
    var E_Coor = x.ToString();
    int E_Fraction_Length = E_Coor.Length - E_Coor.IndexOf('.');
    if(E_Fraction_Length > 4){
      string Ecoor_New = E_Coor.Substring(0, (E_Coor.IndexOf('.') + 4));
      E_Coor = Ecoor_New;
    }
    A = E_Coor;
# ---------- end c_script_2 ----------
split_3 = SplitList(List=c_script_2.A, Index=1)  # -> ListA, ListB

# ---- group: G-code generation / Linear Movement
format_2 = Format(Format="G1 X{0} Y{1} E{2}", Culture=127, Data0=split.ListB, Data1=split_2.ListB, Data2=split_3.ListB)

# ---- group: G-code generation (continued)
ins_2 = InsertItems(List=split_3.ListA, Item=fastmovespeed_2, Indices=0, Wrap=True)
clean_2 = CleanTree(RemoveNulls=True, RemoveInvalid=True, RemoveEmpty=False, Tree=flatten(format_2))
lng_5 = ListLength(List=clean_2)
larger = LargerThan(FirstNumber=lng_5, SecondNumber=0)  # -> LargerThan, OrEqualTo

# ---- group: G-code generation / Rapid Linear Positioning
format_3 = Format(Format="G1 X{0} Y{1} E{3} F{2}", Culture=127, Data0=split.ListA, Data1=split_2.ListA, Data2=int_2, Data3=ins_2)
merge_3 = Merge(Data1="G1 E-1.0000 F1200", Data2="G1 E1.0000 F1200")
ins_3 = InsertItems(List=format_3, Item=merge_3, Indices=[0, 4], Wrap=True)
trim_6 = TrimTree(Tree=ins_3, Depth=1)

# ---- group: G-code generation (continued)
merge_4 = Merge(Data1=trim_6, Data2=format_2)

tstat_2 = TreeStatistics(Tree=merge_4)  # -> Paths, Length, Count
item_10 = ListItem(List=tstat_2.Paths, Index=clean, Wrap=True)  # -> flatten(Item)
branch = TreeBranch(Tree=merge_4, Path=item_10, MaintainPaths=False)

tstat_3 = TreeStatistics(Tree=branch)  # -> Paths, Length, Count
replace = ReplacePaths(Data=branch, Search=tstat_3.Paths, Replace=path)
merge_5 = Merge(Data1=replace, Data2=path_mapper)  # -> flatten(Result)
merge_6 = Merge(Data1=code_injection_head, Data2=merge_5, Data3=code_injection_foot)
dispatch_2 = Dispatch(List=merge_6, DispatchPattern=larger.LargerThan)  # -> ListA, ListB
g_code_for_makerbot = Panel(dispatch_2.ListA)
